# Dynamo graph dynamosat.dyn (Dynamo 1.2.0.2831)

code_block = CodeBlock { Point.ByCoordinates(0,0,0); }
ZAxis = Vector.ZAxis()
byOriginNormal = Plane.ByOriginNormal(origin=code_block, normal=ZAxis)
number_slider = DoubleSlider(7, range=1..20 step 1)
code_block_2 = CodeBlock(nb=number_slider) { 1..44.9..#nb; }
offset = Plane.Offset(byOriginNormal, code_block_2)
file_path = Filename(".\feuille.sat")
importFromSAT = Geometry.ImportFromSAT(file_path)
byJoinedSurfaces = PolySurface.ByJoinedSurfaces(importFromSAT)
intersectAll = Geometry.IntersectAll(geometry=offset, others=byJoinedSurfaces)
levels = Levels("Level 1")
structural_framing_types = StructuralFramingTypes("IPE80")
beamByCurve = StructuralFraming.BeamByCurve(curve=intersectAll, level=levels, structuralFramingType=structural_framing_types)
